# Grasshopper definition 00_Printing-Commenting.gh (Grasshopper 1.0.7)
# Copyright: Arup

python = GhPythonScript()  # -> out, a
# ---------- python: Python ----------
"""Printing and commenting""

__author__ = "gilang.arenza"
__version__ = "2020.04.30"""

#Printing
print ("Hello World")
print (4+5)

#Commenting
# anything after '#' will be ignored
# use this feature to annotate/comment your code
# ---------- end python ----------
