# Grasshopper definition 01_Data_Types.gh (Grasshopper 1.0.7)
# Copyright: Arup

# ----
# statements 2
toggle = BooleanToggle(False)
python = PythonScript(x=toggle)  # -> out, my_str
# ---------- python: Python ----------
"""Data Types
Statements"""

__author__ = "gilang.arenza"
__version__ = "2020.04.30"

if x:
    my_str = "Hello World!"
else:
    my_str = "Nothing to say."
# ---------- end python ----------

# ----
# statements
python_2 = GhPythonScript()  # -> out, a
# ---------- python_2: Python ----------
"""Data Types
method"""

__author__ = "gilang.arenza"
__version__ = "2020.04.30"

#define variable
a = "Hello"
b = "World"
c = a + " " + b

#call method to change the string into lower case
print(c.lower())
#call method to change the string into upper case
print(c.upper())
#get the length of characters
print("jumlah karakter variabel c adalah " + str(len(c)))
# ---------- end python_2 ----------

# ----
# List 2
python_3 = GhPythonScript()  # -> out, a
# ---------- python_3: Python ----------
"""Data Types 2
List"""

__author__ = "gilang.arenza"
__version__ = "2020.04.30"

#list can have multiple data types
my_list = ['apel',150,'pisang',77,'jeruk',23]
#you can add more data to list
my_list.append(7)
#use extend method to add more elements
my_list.extend([1000, 'anggur'])
print (my_list)
# ---------- end python_3 ----------

# ----
# number 2
python_4 = GhPythonScript()  # -> out, a
# ---------- python_4: Python ----------
"""Data Types
Number"""

__author__ = "gilang.arenza"
__version__ = "2020.04.30"

#try to answer this result
#you can assign multiple variables in one line
var_1, var_2 = 15, 6 
task_1 = ((var_1*4)/var_2)-10

#print your result
print (task_1)
# ---------- end python_4 ----------

# ----
# statements
python_5 = GhPythonScript()  # -> out, a
# ---------- python_5: Python ----------
"""Data Types
Boolean"""

__author__ = "gilang.arenza"
__version__ = "2020.04.30"

#indentation is important in Python
x = 5
if (x>6):
    print('x is larger than 6')
elif (x==3):
    print('x is 6')
else:
    print('x is smaller than 6')
# ---------- end python_5 ----------

# ----
# string 2
python_6 = GhPythonScript()  # -> out, a
# ---------- python_6: Python ----------
"""Data Types
String/Text"""

__author__ = "gilang.arenza"
__version__ = "2020.04.30"

#Escape characters" you can't use single/double quote in the middle of text 
txt = "We are the so-called \"Geek\" from the east."

"""
other escape characters
\'    Single Quote    
\\    Backslash    
\n    New Line    
"""
escape_txt = "Hello\nWorld!"
print (escape_txt)
# ---------- end python_6 ----------

# ----
# List 1
python_7 = GhPythonScript()  # -> out, a
# ---------- python_7: Python ----------
"""Data Types 2
List"""

__author__ = "gilang.arenza"
__version__ = "2020.04.30"

#you can create an empty list
numbers = []
#put your data inside square brackets[]
numbers = [1,2,3]
friends = ['Ahmad', 'Hartono', 'Ratna', 'Dewi']
#get first name from the list (index 0)
print (friends[0])
#get last name from the list (index 3)
print (friends[3])
# ---------- end python_7 ----------

# ----
# number 1
python_8 = GhPythonScript()  # -> out, a
# ---------- python_8: Python ----------
"""Data Types
Number"""

__author__ = "gilang.arenza"
__version__ = "2020.04.30"

#integer number
a = 5
b = 6
c = a + b #python can do mathematical operations!
print (c) #print result

#float and integer number
a = 5.0
c = a * 3
#be careful with the dynamic-typed and different data types
print ('c='+ str(c)) #c now has different value
# ---------- end python_8 ----------

# ----
# boolean
python_9 = GhPythonScript()  # -> out, a
# ---------- python_9: Python ----------
"""Data Types
Boolean"""

__author__ = "gilang.arenza"
__version__ = "2020.04.30"

#boolean values are only 'True' and 'False'
print (2 == 2)
print (2 >= 5)

print ('t' in 'Python')
# ---------- end python_9 ----------

# ----
# string 1
python_10 = GhPythonScript()  # -> out, a
# ---------- python_10: Python ----------
"""Data Types
String/Text"""

__author__ = "gilang.arenza"
__version__ = "2020.04.30"

#use '=' to store a variable.
single_quote = 'Single quote allow you to embed "double" quotes in your string.'
double_quote = "Double quote allow you to embed 'single' quotes in your string."
triple_quote = """Triple quotes allows to embed "double quotes" as well as
'single quotes' in your string. 
And can also span across multiple lines."""

print (single_quote)
print (double_quote)
print (triple_quote)
# ---------- end python_10 ----------

panel = Panel(python_3.out)
panel_2 = Panel(python_7.out)
panel_3 = Panel(python_2.out)
panel_4 = Panel(python_10.out)
panel_5 = Panel(python_6.out)
panel_6 = Panel(python_4.out)
panel_7 = Panel(python_8.out)
panel_8 = Panel(python_9.out)
panel_9 = Panel(python_5.out)
panel_10 = Panel(python.my_str)
