# Grasshopper definition 02_RhinoCommon_RhinoScriptSyntax.gh (Grasshopper 1.0.7)
# Copyright: Arup

# Right click and select
# 'Set one Point' for each component
# to create a Grasshopper point
pt = Point(Point(-62, 19, 0))
pt_2 = Point(Point(-28, 38, 0))

# ----
# RhinoCommon with
#                   Coercion
python = PythonScript(x=pt, y=pt_2)  # -> out, a
# ---------- python: Python ----------
import Rhino.Geometry as rg
import rhinoscriptsyntax as rs
a = rg.Line(rs.coerce3dpoint(x),rs.coerce3dpoint(y))
# ---------- end python ----------

# ----
# RhinoCommon with
#                   Type Hint
python_2 = PythonScript(x=pt, y=pt_2)  # -> out, a; inputs x: Point3d, y: Point3d
# ---------- python_2: Python ----------
import Rhino.Geometry as rg
a = rg.Line(x,y)
# ---------- end python_2 ----------

# ----
# RhinoScriptSyntax
python_3 = PythonScript(x=pt, y=pt_2)  # -> out, a
# ---------- python_3: Python ----------
import rhinoscriptsyntax as rs
a = rs.AddLine(x,y)
# ---------- end python_3 ----------
