# Grasshopper definition 02_Subdivision_Recursive.gh (Grasshopper 1.0.7)

# ----
# NURBS Surface
x = Slider(23, range=0..100)
python = GhPythonScript(u=x, v=Slider(20, range=0..100), z=Slider(3.86, range=0..10), f=Slider(0.43, range=0..1))  # -> out, pts, nurbs_Srf; inputs u: Int32, v: Int32
# ---------- python: Python ----------
__author__ = "gilang.judhinaputra"
__version__ = "2020.04.15"


import Rhino as rh
import math

pts = []

for i in range(u):
    for j in range(v):
        pt_z = math.sin(i*f) * math.sin(j*f) * z
        pt = rh.Geometry.Point3d(i,j, pt_z)
        pts.append(pt)

nurbs_Srf = rh.Geometry.NurbsSurface.CreateFromPoints(pts, u, v,4,4)
# ---------- end python ----------
srf = Surface(python.nurbs_Srf)

dam = DataDam(DataA=srf, BufferDelay=10000000, BufferMode=1)

# ----
# Recursive Function
number_slider = Slider(0.45, range=0.01..5)
python_2 = GhPythonScript(srf=dam, tol=number_slider)  # -> out, sub_Srfs; inputs srf: Surface
# ---------- python_2: Python ----------
__author__ = "Zuardin Akbar"
__version__ = "2020.04.18"

"""
Component Input 1 -- srf, 
Item Access, 
Type Hint: Surface

Component Input 2 -- tol, 
Item Access, 
Type Hint: float
"""

import Rhino as rh

def Subdivide(_srf, _tol):
    
    #Get the the U & V domain of the _srf as intervals
    u = rh.Geometry.Surface.Domain(_srf, 0)
    v = rh.Geometry.Surface.Domain(_srf, 1)
    
    #Get the domain edge values
    uMin = u.Min
    uMax = u.Max
    vMin = v.Min
    vMax = v.Max
    
    #Get the middle value of the domains
    uMid = (uMax+uMin)/2
    vMid = (vMax+vMin)/2
    
    #Create Division Intervals
    u0 = rh.Geometry.Interval(uMin, uMid)
    u1 = rh.Geometry.Interval(uMid, uMax)
    v0 = rh.Geometry.Interval(vMin, vMid)
    v1 = rh.Geometry.Interval(vMid, vMax)
    
    #Recursive Part
    #Evaluate Planarity Tolerance
    if rh.Geometry.Surface.IsPlanar(_srf, _tol):
        sub_Srfs.append(_srf)
    else:
        #Trim the _srf using the intervals (Surface division)
        s0 = rh.Geometry.Surface.Trim(_srf, u0, v0)
        s1 = rh.Geometry.Surface.Trim(_srf, u1, v0)
        s2 = rh.Geometry.Surface.Trim(_srf, u0, v1)
        s3 = rh.Geometry.Surface.Trim(_srf, u1, v1)
        
        #Subdivide again
        Subdivide(s0, _tol)
        Subdivide(s1, _tol)
        Subdivide(s2, _tol)
        Subdivide(s3, _tol)

#OUTPUT
sub_Srfs = [] 

#MAIN PROGRAM
Subdivide(srf, tol)
# ---------- end python_2 ----------
