# Grasshopper definition Recursive_Panel_Subdivision.gh (Grasshopper 1.0.7)

x = Slider(23, range=0..100)
python = GhPythonScript(u=x, v=Slider(20, range=0..100), z=Slider(3.86, range=0..10), f=Slider(0.43, range=0..1))  # -> out, pts, nurbs_Srf; inputs u: Int32, v: Int32
# ---------- python: Python ----------
__author__ = "gilang.judhinaputra"
__version__ = "2020.04.15"


import Rhino as rh
import math

pts = []

for i in range(u):
    for j in range(v):
        pt_z = math.sin(i*f) * math.sin(j*f) * z
        pt = rh.Geometry.Point3d(i,j, pt_z)
        pts.append(pt)

nurbs_Srf = rh.Geometry.NurbsSurface.CreateFromPoints(pts, u, v,4,4)
# ---------- end python ----------
srf = Surface(python.nurbs_Srf)
dam = DataDam(DataA=srf, BufferDelay=10000000, BufferMode=0)
python_2 = GhPythonScript(srf=srf)  # -> out, sub_Srfs; inputs srf: Surface
# ---------- python_2: Python ----------
__author__ = "Zuardin Akbar"
__version__ = "2020.04.18"

import Rhino as rh

#Create emptylist
listOfSubSurfaces = []

#Get the the U & V domain of the surface as intervals
u = rh.Geometry.Surface.Domain(srf, 0)
v = rh.Geometry.Surface.Domain(srf, 1)

#Get the domain edge values
uMin = u.Min
uMax = u.Max
vMin = v.Min
vMax = v.Max

#Get the middle value of the domains
uMid = (uMax+uMin)/2
vMid = (vMax+vMin)/2

#Create Division Intervals
u0 = rh.Geometry.Interval(uMin, uMid)
u1 = rh.Geometry.Interval(uMid, uMax)
v0 = rh.Geometry.Interval(vMin, vMid)
v1 = rh.Geometry.Interval(vMid, vMax)

#Trim the surface using the intervals (Surface division)
s0 = rh.Geometry.Surface.Trim(srf, u0, v0)
s1 = rh.Geometry.Surface.Trim(srf, u1, v0)
s2 = rh.Geometry.Surface.Trim(srf, u0, v1)
s3 = rh.Geometry.Surface.Trim(srf, u1, v1)

#Add the splited surfaces into the list
listOfSubSurfaces.append(s0)
listOfSubSurfaces.append(s1)
listOfSubSurfaces.append(s2)
listOfSubSurfaces.append(s3)

#OUTPUT
sub_Srfs = listOfSubSurfaces
# ---------- end python_2 ----------
python_3 = GhPythonScript(srf=srf)  # -> out, sub_Srfs; inputs srf: Surface
# ---------- python_3: Python ----------
__author__ = "Zuardin Akbar"
__version__ = "2020.04.18"

import Rhino as rh

def Subdivide(_srf):
    #Create emptylist
    listOfSubSurfaces = []
    
    #Get the the U & V domain of the surface as intervals
    u = rh.Geometry.Surface.Domain(_srf, 0)
    v = rh.Geometry.Surface.Domain(_srf, 1)
    
    #Get the domain edge values
    uMin = u.Min
    uMax = u.Max
    vMin = v.Min
    vMax = v.Max
    
    #Get the middle value of the domains
    uMid = (uMax+uMin)/2
    vMid = (vMax+vMin)/2
    
    #Create Division Intervals
    u0 = rh.Geometry.Interval(uMin, uMid)
    u1 = rh.Geometry.Interval(uMid, uMax)
    v0 = rh.Geometry.Interval(vMin, vMid)
    v1 = rh.Geometry.Interval(vMid, vMax)
    
    #Trim the surface using the intervals (Surface division)
    s0 = rh.Geometry.Surface.Trim(_srf, u0, v0)
    s1 = rh.Geometry.Surface.Trim(_srf, u1, v0)
    s2 = rh.Geometry.Surface.Trim(_srf, u0, v1)
    s3 = rh.Geometry.Surface.Trim(_srf, u1, v1)
    
    #Add the splited surfaces into the list
    listOfSubSurfaces.append(s0)
    listOfSubSurfaces.append(s1)
    listOfSubSurfaces.append(s2)
    listOfSubSurfaces.append(s3)
    
    return listOfSubSurfaces

#OUTPUT
sub_Srfs = Subdivide(srf)
# ---------- end python_3 ----------
python_4 = GhPythonScript(srf=dam, tol=Slider(0.01, range=0..5))  # -> out, sub_Srfs; inputs srf: Surface
# ---------- python_4: Python ----------
__author__ = "Zuardin Akbar"
__version__ = "2020.04.18"

import Rhino as rh

def Subdivide(_srf):
    
    #Get the the U & V domain of the _srf as intervals
    u = rh.Geometry.Surface.Domain(_srf, 0)
    v = rh.Geometry.Surface.Domain(_srf, 1)
    
    #Get the domain edge values
    uMin = u.Min
    uMax = u.Max
    vMin = v.Min
    vMax = v.Max
    
    #Get the middle value of the domains
    uMid = (uMax+uMin)/2
    vMid = (vMax+vMin)/2
    
    #Create Division Intervals
    u0 = rh.Geometry.Interval(uMin, uMid)
    u1 = rh.Geometry.Interval(uMid, uMax)
    v0 = rh.Geometry.Interval(vMin, vMid)
    v1 = rh.Geometry.Interval(vMid, vMax)
    
    #Evaluate Tolerance
    p0 = rh.Geometry.Surface.PointAt(_srf, uMin, vMin)
    p1 = rh.Geometry.Surface.PointAt(_srf, uMin, vMax)
    p2 = rh.Geometry.Surface.PointAt(_srf, uMax, vMin)
    p3 = rh.Geometry.Surface.PointAt(_srf, uMax, vMax)
    
    if rh.Geometry.Surface.IsPlanar(_srf, tol):
        listOfSubSurfaces.append(_srf)
    else:
        #Trim the _srf using the intervals (Surface division)
        s0 = rh.Geometry.Surface.Trim(_srf, u0, v0)
        s1 = rh.Geometry.Surface.Trim(_srf, u1, v0)
        s2 = rh.Geometry.Surface.Trim(_srf, u0, v1)
        s3 = rh.Geometry.Surface.Trim(_srf, u1, v1)
        
        #Subdivide again
        Subdivide(s0)
        Subdivide(s1)
        Subdivide(s2)
        Subdivide(s3)

#MAIN PROGRAM
listOfSubSurfaces = []
Subdivide(srf)

#OUTPUT
sub_Srfs = listOfSubSurfaces
# ---------- end python_4 ----------
