# Grasshopper definition Intro_Python.gh (Grasshopper 1.0.7)

# ---- group: String
python = PythonScript(x=Toggle(False))  # -> out, my_str
# ---------- python: Python ----------
a = "Hello"
b = "World"
c = a + " " + b
print(c)

print(c.lower())
print(c.upper())
print("jumlah karakter variable c adalah " + str(len(c)))

if x:
    my_str = "Hello World!"
else:
    my_str = "Nothing to say."
# ---------- end python ----------

# ----
pt = Point(Point(-62, 19, 0))
pt_2 = Point(Point(-28, 38, 0))

# ---- group: For Loop w Random
python_2 = GhPythonScript(reset=Button())  # -> out, math_pts; inputs reset: Boolean
# ---------- python_2: Python ----------
__author__ = "gilang.judhinaputra"
__version__ = "2020.04.15"

import math
import Rhino as rh
import random

math_pts = []

if 'counter' not in globals():
    global counter
    counter = 0
    
else:
    global counter
    counter = 1
    for i in range(500):
        x = math.cos(i*0.2) * i*0.1
        y = math.sin(i*0.2) * i*0.08
        if(i < 200):
            z = 0
        else:
            z = random.random() * (i-200)* 0.02
        p = rh.Geometry.Point3d(x,y,z)
        math_pts.append(p)
    counter = 0
# ---------- end python_2 ----------

# ----
panel = Panel(python.my_str)

# ---- group: For Loop 1 & if else
python_3 = GhPythonScript()  # -> out, math_pts
# ---------- python_3: Python ----------
__author__ = "gilang.judhinaputra"
__version__ = "2020.04.15"

import math
import Rhino as rh

math_pts = []
for i in range(500):
    x = math.cos(i*0.1) * i*0.1
    y = math.sin(i*0.1) * i*0.08
    if(i < 200):
        z = i*0.05
    else:
        z = 20-i*0.05
    p = rh.Geometry.Point3d(x,y,z)
    math_pts.append(p)
# ---------- end python_3 ----------

# ---- group: Nested Loop
x = Slider(64, range=0..100)
# Function in Python
# - nGon
# - KAIT institute
python_4 = GhPythonScript(x=x, y=Slider(40, range=0..100), z=Slider(3.86, range=0..10), u=Slider(0.44, range=0..1))  # -> out, pts, my_polylines, nested_pts; inputs x: Int32, y: Int32
# ---------- python_4: Python ----------
__author__ = "gilang.judhinaputra"
__version__ = "2020.04.15"


import Rhino as rh
import math
import ghpythonlib as ghp

pts = []

for i in range(x):
    for j in range(y):
        pt_z = math.sin(i*u) * math.sin(j*u) * z
        pt = rh.Geometry.Point3d(i,j, pt_z)
        pts.append(pt)

#create mesh from list of points
nested_pts, my_polylines = [], []
i = 0

while i < len(pts):
    nested_pts.append(pts[i:i+y])
    i += y

for i in nested_pts:
    my_polyline = rh.Geometry.Polyline(i)
    my_polylines.append(my_polyline.ToPolylineCurve())

nested_pts = ghp.treehelpers.list_to_tree(nested_pts)
# ---------- end python_4 ----------

# ----
# RhinoCommon with
#                   Coercion
python_5 = PythonScript(x=pt, y=pt_2)  # -> out, a
# ---------- python_5: Python ----------
import Rhino.Geometry as rg
import rhinoscriptsyntax as rs
a = rg.Line(rs.coerce3dpoint(x),rs.coerce3dpoint(y))
# ---------- end python_5 ----------

# ----
# RhinoCommon with
#                   Type Hint
python_6 = PythonScript(x=pt, y=pt_2)  # -> out, a; inputs x: Point3d, y: Point3d
# ---------- python_6: Python ----------
import Rhino.Geometry as rg
a = rg.Line(x,y)
# ---------- end python_6 ----------

# ----
# RhinoScriptSyntax
python_7 = PythonScript(x=pt, y=pt_2)  # -> out, a
# ---------- python_7: Python ----------
import rhinoscriptsyntax as rs
a = rs.AddLine(x,y)
# ---------- end python_7 ----------

python_8 = GhPythonScript()  # -> out, a
# ---------- python_8: Python ----------
single_quote = 'Single quote allow you to embed "double" quotes in your string.'
double_quote = "Double quote allow you to embed 'single' quotes in your string."
triple_quote = """Triple quotes allows to embed "double quotes" as well as
'single quotes' in your string. 
And can also span across multiple lines."""

print (single_quote)

print (double_quote)

print (triple_quote)

#Escape characters" you can't use single/double quote in the middle of text 
txt = "We are the so-called \"Geek\" from the east."

"""
other escape characters
\'	Single Quote	
\\	Backslash	
\n	New Line	
"""
escape_txt = "Hello\nWorld!"
print (escape_txt)

#Text Format
txt_1 = "My name is {fname}, I'am {age} yeas old".format(fname = "Bahar", age = 21)
txt_2 = "My name is {0}, I'am {1} yeas old".format("Bahar",21)
# ---------- end python_8 ----------
pt_3 = Point(Point(2.783630465, 2.667645862, 0))
# Variable:
# - String:
# string format
# - Boolean
# - Numbers (integer/float/double)
# simple math operation with numbers
# - Rhinoscriptsyntax vs Rhinocommon
# - Create point 3D
# - Create lines from Point3d
panel_2 = Panel(python_8.out)
# List, For Loop, Conditional Statement:
# 
# - Grid of Points (2d & 3d)
# - import math
# - import random
# - Looping
# - Nested Loop
# - List comprehension
python_9 = GhPythonScript()  # -> out, a
# ---------- python_9: Python ----------
__author__ = "gilang.judhinaputra"
__version__ = "2020.04.16"

import Rhino as rh

x_size = 10
y_size = 10
z_size = 10

a = []
for i in range(x_size):
    for j in range(y_size):
        for u in range(z_size):
            a.append(rh.Geometry.Point3d(i,j,u))
# ---------- end python_9 ----------

# ---- group: Function
python_10 = PythonScript(C=pt_3, R=Slider(6.3, range=0..10), N=Slider(7, range=3..15))  # -> out, P; inputs C: Point3d
# ---------- python_10: Python ----------
import Rhino as rh
import math

def nGon(centre, radius, n_sides):
    x, y, z = centre
    angles = [2 * math.pi * i / n_sides for i in range(0,int(n_sides))] #list comprehension
    list_of_coord = [(x + radius * math.cos(ang), y + radius * math.sin(ang), z) for ang in angles] #list comprehension
    return list_of_coord  # [[2.4, 5.5, 3,8], [2.7, 5.4, 3,8],[...]]

#list comprehension
pts = [rh.Geometry.Point3d(pt[0], pt[1], pt[2]) for pt in nGon(C, R, N)]
closed_pts = pts + [pts[0]]

my_polyline = rh.Geometry.Polyline(closed_pts)
P = my_polyline.ToPolylineCurve()
# ---------- end python_10 ----------
